# Grasshopper definition system.gh (Grasshopper 1.0.7)
# plug-ins: Human, Kangaroo2 Components

number_slider = Slider(100, range=0..100)
number_slider_2 = Slider(2000, range=0..10000)
R = Region({Plane=PlaneXY(50, 50, 0), Size=Domain2(u=-50..50, v=-50..50)})
number_slider_3 = Slider(10, range=0..10)
pop2d = Populate2D(Region=R, Count=Slider(1000, range=0..1000), Seed=1)
pop2d_2 = Populate2D(Region=R, Count=Slider(18, range=0..100), Seed=1)
pt = ConstructPoint(XCoordinate=0, YCoordinate=0, ZCoordinate=0)
list = ValueList({"open", "closed"}, selected="open")
pt_2 = Point([<point referenced from the Rhino model> x14])
pt_3 = Point(pt_2)
python = GhPythonScript(
    seeds=pop2d,
    root_node=pt_3,
    venation_type=list,
    iterations=Slider(35, range=0..35),
    attraction_distance=Slider(8.4, range=0..100),
    kill_distance=Slider(1, range=0..10))  # -> out, artist, weights, root_tree; inputs seeds: list of Point3d, root_node: list of Point3d, iterations: Int32
# ---------- python: Python ----------
import Rhino.Geometry as rg
from random import random, randrange, uniform, seed
import Rhino.Geometry as rg
from Rhino.Geometry import Point3d as Point
from Rhino.Geometry import Vector3d as Vector
from Rhino.Geometry import Line
import Network, Attractor, Node
from Node import Node as No
from Attractor import Attractor as Att
from Network import Network as Net
import imp
from ghpythonlib.treehelpers import list_to_tree as ltt

seed(10)
imp.reload(Network)
imp.reload(Node)
imp.reload(Attractor)

network = Net(venation_type)
network.attractors = [Att(seed) for seed in seeds]

network.length = 1.5

network.attraction_distance = attraction_distance
network.kill_distance = kill_distance
for r in root_node:
    network.add_node(No(None, r, True))

for _ in range(iterations):
    network.update()

n_list =  network.node_list

artist = network.draw()[0]
weights = ltt(network.draw()[1])

root_tree =  ltt(network.branch_tree())
# ---------- end python ----------
dots = DotDisplay(Point=pt_3, Colour=ColourSwatch(SwatchColor=RGB(22, 106, 196)), Size=Slider(0.3, range=0..1))
panel = Panel(python.root_tree)
branch = TreeBranch(Tree=simplify(python.root_tree), Path=Slider(0, range=0..10), MaintainPaths=True)
end = EndPoints(Curve=python.root_tree)  # -> Start, End
cull_i = CullIndex(List=end.End, Indices="-1", Wrap=True)
multiplication = Multiplication(A=python.weights, B=Slider(4, range=0..10))
hull = ConvexHull(Points=cull_i, Plane=PlaneXY(0, 0, 0))  # -> Hull, HullZ, Indices
crv = Curve(hull.Hull)
previewlw = CustomPreviewLineweights(Geometry=python.artist, Shader=ColourSwatch(SwatchColor=RGB(166, 63, 102)), Thickness=multiplication, Absolute=False)
area = Area(Geometry=crv)  # -> Area, Centroid
explode = Explode(Curve=hull.Hull, Recursive=True)  # -> Segments, Vertices
ln = Line(StartPoint=explode.Vertices, EndPoint=area.Centroid)
number_slider_4 = Slider(63, range=0..100)
number_slider_5 = Slider(1, range=0..1)
dupln = RemoveDuplicateLines(Lines=ln, Tolerance=0.01)
trim = TrimTree(Tree=dupln, Depth="2")
python_2 = GhPythonScript(line_tree=trim, tolerance=Slider(7.2, range=0..10))  # -> out, pt_tree; inputs line_tree: tree of Line
# ---------- python_2: Python ----------
import Rhino.Geometry as rg
import random as r
from ghpythonlib.treehelpers import tree_to_list as ttl
from ghpythonlib.treehelpers import list_to_tree as ltt

import imp
imp.reload(r)
line_tree = ttl(line_tree)
cull_lines = []

r.seed(10)

for lines in line_tree:
    line_list = sorted(lines, key = lambda line : line.Length)
    line_list.reverse()
    item0 = line_list[0]
    list_list = [item0]
    print len(line_list)
    for line in line_list:
        distances =  [line.PointAt(0).DistanceTo(i.PointAt(0)) for i in list_list]
        d = min(distances)
        if d > tolerance:
            item_next = line
            item0 = item_next
            list_list.append(item_next)
        else:
            continue
        if len(list_list) > 2:
            break
    cull_lines.append(list_list)

pt_tree = []
for lines in cull_lines:
    line_pts = []
    for line in lines:
        line_pts.append(line.PointAt(r.uniform(0.5,0.8)))
    pt_tree.append(line_pts)

pt_tree = ltt(pt_tree)
# ---------- end python_2 ----------
pt_4 = Point(python_2.pt_tree)
